# Grasshopper definition RGB.gh (Grasshopper 0.9.76)

c_script = CSharpScript()  # -> out, A, B, C
# ---------- c_script: C# ----------
    List<int> index = new List<int>();
    for(int i = 0;i < 0x0FF;i++){
      index.Add(i);
    }
    A = 0;B = 0x0FF;
    C = index;
# ---------- end c_script ----------
gradient = Gradient(
    LowerLimit=c_script.A,
    UpperLimit=c_script.B,
    Parameter=c_script.C,
    stops=[0: RGB(243, 57, 0), 0.0746: RGB(236, 27, 60), 0.165: RGB(210, 0, 118), 0.254: RGB(103, 0, 120), 0.4: RGB(39, 72, 161), 0.5: RGB(1, 192, 229), 0.6: RGB(18, 178, 90), 0.7: RGB(79, 186, 8), 0.8: RGB(220, 237, 32), 0.9: RGB(247, 159, 20), 1: RGB(243, 57, 0)])
c_script_2 = CSharpScript(x=gradient)  # -> out, A, B, C; inputs x: list of Color
# ---------- c_script_2: C# ----------
    string Red="{",Green = "{",Blue = "{";
    for(int i = 0;i < x.Count;i++){
      Red += x[i].R.ToString();
      if(i < x.Count - 1)Red += ",";
      if((i + 1) % 25 == 0)Red += "\r\n";
      Green += x[i].G.ToString();
      if(i < x.Count - 1)Green += ",";
      if((i + 1) % 25 == 0)Green += "\r\n";
      Blue += x[i].B.ToString();
      if(i < x.Count - 1)Blue += ",";
      if((i + 1) % 25 == 0)Blue += "\r\n";
    }
    Red += "}";Green += "}";Blue += "}";
    A = Red;
    B = Green;
    C = Blue;
# ---------- end c_script_2 ----------
panel = Panel(c_script_2.C)
